# Grasshopper definition stair_generation_algorithm.gh (Grasshopper 1.0.7)

# Definition for the creation of stairs within a cell of the grid, for a given starting and ending point
# Author: Anastasia Florou
# 
# Adjusted on August 2021
panel = Panel("""AR3B011 EARTHY

October 2020""")

# ---- group: User input
grid_size = Slider(3.6, range=3.2..4.6)
step_height = Slider(0.17, range=0.15..0.2)
subdivisions = Slider(4, range=2..6)
floor_height = Slider(2.9, range=2.6..3.2)
min_step_width = Slider(0.25, range=0.25..0.3)

# ---- group: Select starting and ending cell
starting_cell = Slider(8, range=0..12)
ending_cell = Slider(2, range=0..12)

# ---- group: Create grid
# Create grid and select start and end
division = Division(A=grid_size, B=subdivisions)
sqgrid = Square(Plane=PlaneXY(0, 0, 0), Size=division, ExtentX=subdivisions, ExtentY=subdivisions)  # -> Cells, Points

# ---- group: Find outer cells
sunion = SolidUnion(Breps=flatten(sqgrid.Cells))
area = Area(Geometry=sqgrid.Cells)  # -> Area, Centroid
edges = BrepEdges(Brep=sunion)  # -> Naked, Interior, NonManifold
join = JoinCurves(Curves=edges.Naked, Preserve=False)
crv_cp = CurveClosestPoint(Point=flatten(area.Centroid), Curve=join)  # -> Point, Parameter, Distance
sort = SortList(Keys=crv_cp.Distance, ValuesA=flatten(sqgrid.Cells))  # -> Keys, ValuesA
item = ListItem(List=sort.Keys, Index=0, Wrap=True)
mindex = MemberIndex(Set=crv_cp.Distance, Member=item)  # -> Index, Count
item_2 = ListItem(List=flatten(sqgrid.Cells), Index=mindex.Index, Wrap=True)

# ---- group: Find outer cells / Outer cells
srf = Surface(item_2)

# ---- group: Navigate through the alternatives
button = Button()

# ---- group: Start & End
item_3 = ListItem(List=srf, Index=starting_cell, Wrap=True)
item_4 = ListItem(List=srf, Index=ending_cell, Wrap=True)

# ---- group: Start & End / Starting cell
srf_2 = Surface(item_3)

# ---- group: Start & End / Ending cell
srf_3 = Surface(item_4)

# ---- group: Start & End (continued)
area_2 = Area(Geometry=srf_2)  # -> Area, Centroid
area_3 = Area(Geometry=srf_3)  # -> Area, Centroid

# ----
# Stair solver
# (Python script)
pt = Point(flatten(area.Centroid))
pt_2 = Point(area_2.Centroid)
pt_3 = Point(area_3.Centroid)
stairsolver = GhPythonScript(
    start_point=pt_2,
    end_point=pt_3,
    all_points=pt,
    cell_edge=division,
    min_step_width=min_step_width,
    step_height=step_height,
    floor_height=floor_height,
    x=button)  # -> out, route, step_height; inputs start_point: Point3d, end_point: Point3d, all_points: list of Point3d
# ---------- stairsolver: Python ----------
__author__ = "Anastasia Florou"
__initial_version__ = "October 2020"
__adjusted_version__ = "August 2021"

"""Given a cell (part of a greater grid of a modular design project) divided into sub-cells,
a starting and an ending subcell and some stair properties, this script is generating modular stair solutions.
    Inputs:
        start_point: centroid of the starting cell
        end_point: centroid of the ending cell
        all_points: centroids of all the cells
        stair properties as user input:
            cell_edge: length of cell edge
            min_step_width: minimum width of step allowed
            step_height: proposed step height
            floor_height: height of the floor (where the stair needs to reach)
        x: random seed to generate alternative solutions
    Output:
        route: list of cell objects with specific attributes"""

# import libraries
import rhinoscriptsyntax as rs
import random 
import Grasshopper as gh
import sys
import copy
import math

# create Step class
class Step:
    
    """Calculate how many steps fit in one cell of the grid
    and how much is their width based on the minimum allowed"""
    steps_per_cell = int(math.floor(cell_edge / min_step_width))
    step_width = cell_edge / steps_per_cell

    # calculate minimum number of steps needed
    min_steps = int(math.ceil(floor_height/step_height))
    
    # adjusted step_height
    step_height = floor_height/min_steps

    def __init__(self, centroid, start_level = None, status = False, substeps = 0):
        self.centroid = centroid # coordinates of the centroid of the cell
        self.status = status # True = occupied/used & False = unoccupied
        self.start_level = start_level # the level at which the step begins
        self.substeps = substeps
        
    @classmethod
    def set_stepheight(cls, steps_height):
        cls.step_height = step_height
        
        
    def find_avail_neighs(self, cells_cloud):
        """Find available (unoccupied cells) neighbors for a particular cell"""
        p1 = self.centroid # point for which we check
        avail_neighs = []
        for cell in cells_cloud:
            p2 = cell.centroid
            if cell.status == False:
                p_dist = round(math.sqrt(((p1[0]-p2[0])**2)+((p1[1]-p2[1])**2)),2)
                if p_dist == cell_edge:
                    avail_neighs.append(cell)
        return avail_neighs
    
    def check_alignment(self, previous_cell, next_cell):
        """Check if a particular cell is in the same line with the previous and the next one"""
        p1 = self.centroid # point for which we check
        pt0 = self.centroid
        ptA = previous_cell.centroid
        ptB = next_cell.centroid
        if round(pt0.X, 2) == round(ptA.X, 2) and round(pt0.X, 2) == round(ptB.X, 2):
            return True
        elif round(pt0.Y, 2) == round(ptA.Y, 2) and round(pt0.Y, 2) == round(ptB.Y, 2):
            return True
        else:
            return False

# create Step instances from points
all_cells = []
for point in all_points:
    # create first step
    if round(point.X,2) == round(start_point.X,2) and round(point.Y,2) == round(start_point.Y,2):
        step0 = Step(start_point, 0, True)
    else:
        cell = Step(point)
        all_cells.append(cell)

steps_count  = 0

attempts = 0
limit = 10000  # limit of attempts to find a "route"

while steps_count < Step.min_steps and attempts < limit:
    
    steps_count  = 0

    seed = random.randrange(sys.maxsize)
    rnd = random.Random(seed)
    
    current_cell = step0
    
    # make a deep copy of the available cells
    avail_cells = copy.deepcopy(all_cells)
    
    # initiate a list for the sequencial cells as the "route" of the stairs
    route = []
    
    # set the start of the route on our starting point
    route.append(current_cell)
    
    last_met = False  # check if we have reached the last cell

    zero_route = False  # check if we reached a point that the route cannot continue

    while not last_met:

        avail_moves = current_cell.find_avail_neighs(avail_cells)

        while len(avail_moves) == 0:
            route.remove(current_cell)
            if len(route) == 0:
                zero_route = True
                attempts += 1
                break
            current_cell = route[-1]
            avail_moves = current_cell.find_avail_neighs(avail_cells)

        if zero_route:
            if attempts == limit:
                print("No solution found! Press the button to generate an alternative solution.")
            break

        else:
            current_cell = rnd.choice(avail_moves)
            current_cell.status = True
            route.append(current_cell)
            last_met = round(current_cell.centroid.X,2) == round(end_point.X,2) and round(current_cell.centroid.Y,2) == round(end_point.Y,2)
            
    # calculate total number of steps
    if not zero_route:
        
        for i,cell in enumerate(route):
            # first step
            if i == 0:
                steps_count += 1
                cell.substeps = 1 
                cell.start_height = 0
                
            # intermediate steps
            elif i>0 and i<(len(route)-1):
                
                if steps_count < Step.min_steps:
                
                    # how many steps are still needed
                    steps_still = Step.min_steps - steps_count
                    
                    # step starting height
                    start_h = steps_count*Step.step_height
                    cell.start_height = start_h
                    
                    # if the cell is aligned with the previous and the next one it can have sub-steps, otherwise it's a landing
                    aligned = cell.check_alignment(route[i-1], route[i+1])
                    if aligned:
                        if steps_still > Step.steps_per_cell:
                            cell.substeps = Step.steps_per_cell
                            steps_count += Step.steps_per_cell
                        else:
                            cell.substeps = steps_still
                            steps_count += steps_still
                    else:
                        cell.substeps = 1
                        steps_count += 1
                        
                        
                # last step
                else:
                    cell.substeps = 1
                    steps_count += 1
                    
step_height = Step.step_height

if attempts < limit:
    print("Solution generated")
# ---------- end stairsolver ----------
python = GhPythonScript(route=stairsolver.route)  # -> out, centroids, substeps; inputs route: list
# ---------- python: Python ----------
__author__ = "Anastasia Florou"
__initial_version__ = "November 2020"
__adjusted_version__ = "August 2021"

import rhinoscriptsyntax as rs

# initialize lists
centroids = []
substeps = []

for i, cell in enumerate(route):
    centroids.append(cell.centroid)
    substeps.append(cell.substeps)
# ---------- end python ----------

# ---- group: Navigate through the alternatives (continued)
solver_s_result = Panel(stairsolver.out)

# ----
# Sub-classes alternative
# (Doesn't work with IronPython)
stairsolver_2 = GhPythonScript(
    start_point=pt_2,
    end_point=pt_3,
    all_points=pt,
    cell_edge=division,
    min_step_width=min_step_width,
    step_height=step_height,
    floor_height=floor_height,
    x=button)  # -> out, route_pts, step_type; inputs start_point: Point3d, end_point: Point3d, all_points: list of Point3d; disabled
# ---------- stairsolver_2: Python ----------
# import libraries
import rhinoscriptsyntax as rs
import random 
import Grasshopper as gh
import sys
import copy
import math

# create Step class
class Step:
    
    """Calculate how many steps fit in one cell of the grid
    and how much is their width based on the minium allowed"""
    steps_per_cell = int(math.floor(cell_edge / min_step_width))
    step_width = cell_edge / steps_per_cell

    # calculate minimum number of steps needed
    min_steps = int(math.ceil(floor_height/step_height))
    
    # adjusted step_height
    step_height = floor_height/min_steps

    def __init__(self, centroid, start_level = None, status = False):
        self.centroid = centroid # coordinates of the centroid of the cell
        self.status = status # True = occupied/used & False = unoccupied
        self.start_level = start_level # the level at which the step begins
        
    @classmethod
    def set_stepheight(cls, steps_height):
        cls.step_height = step_height
        
        
    def find_avail_neighs(self, cells_cloud):
        """Find available (unoccupied cells) neighbors for a particular cell"""
        p1 = self.centroid # point for which we check
        avail_neighs = []
        for cell in cells_cloud:
            p2 = cell.centroid
            if cell.status == False:
                p_dist = round(math.sqrt(((p1[0]-p2[0])**2)+((p1[1]-p2[1])**2)),2)
                if p_dist == cell_edge:
                    avail_neighs.append(cell)
        return avail_neighs
    
    def check_alignment(self, previous_cell, next_cell):
        pt0 = self.centroid
        ptA = previous_cell.centroid
        ptB = next_cell.centroid
        if round(pt0.X, 2) == round(ptA.X, 2) and round(pt0.X, 2) == round(ptB.X, 2):
            return True
        elif round(pt0.Y, 2) == round(ptA.Y, 2) and round(pt0.Y, 2) == round(ptB.Y, 2):
            return True
        else:
            return False

# create subclasses for type of cells
# Landing class (landing = when the cell contains only one step)
class Landing(Step):
    def __init__(self, centroid, start_level, substeps):
        super(Landing, self).__init__(centroid, start_level)
        self.substeps = int(substeps) # for landing cells this is 0 or 1
        self.end_level = self.start_level + substeps*step_height

# Midsteps class (midsteps = when the cell contains more than one steps)
class Midsteps(Step):
    def __init__(self, centroid, start_level, status, substeps):
        super(Midsteps, self).__init__(centroid, start_level, status)
        self.substeps = int(substeps)
        self.midlevels = []
        if substeps>0:
            for i in range(substeps):
                next_level = start_level + (i+1)*step_height
                self.midlevels.append(next_level)

# create Step instances from points
all_cells = []
for point in all_points:
    # create first step
    if round(point.X,2) == round(start_point.X,2) and round(point.Y,2) == round(start_point.Y,2):
        step0 = Step(start_point, 0, True)
    else:
        cell = Step(point)
        all_cells.append(cell)

steps_count  = 2 # counting already the first and last landing

attempts = 0
limit = 10000  # limit of attempts to find a "route"

while steps_count < Step.min_steps and attempts < limit:

    seed = random.randrange(sys.maxsize)
    rnd = random.Random(seed)
    
    current_cell = step0
    
    # make a deep copy of the available cells
    avail_cells = copy.deepcopy(all_cells)
    
    # initiate a list for the sequencial cells as the "route" of the stairs
    route = []
    
    # set the start of the route on our starting point
    route.append(current_cell)
    
    last_met = False  # check if we have reached the last cell

    zero_route = False  # check if we reached a point that the route cannot continue

    while not last_met:

        avail_moves = current_cell.find_avail_neighs(avail_cells)

        while len(avail_moves) == 0:
            route.remove(current_cell)
            if len(route) == 0:
                zero_route = True
                attempts += 1
                break
            current_cell = route[-1]
            avail_moves = current_cell.find_avail_neighs(avail_cells)

        if zero_route:
            if attempts == limit:
                print("No solution found! Press the button to generate an alternative solution.")
            break

        else:
            current_cell = rnd.choice(avail_moves)
            current_cell.status = True
            route.append(current_cell)
            last_met = round(current_cell.centroid.X,2) == round(end_point.X,2) and round(current_cell.centroid.Y,2) == round(end_point.Y,2)
            
    # calculate total number of possible steps
    if not zero_route:
        # initiate list of sequencial steps
        route_steps = []
        for i,cell in enumerate(route):
            ct = cell.centroid
            if i == 0:
                steps_count += 1
                stp = Landing(ct, 0, 1) 
                route_steps.append(stp)
            elif i>0 and i<(len(route)-1):
                # how many steps are still needed
                steps_still = Step.min_steps - steps_count
                # step starting height
                start_h = steps_count*Step.step_height
                # if the cell is aligned with the previous and the next one it can have sub-steps, otherwise it's a landing
                aligned = cell.check_alignment(route[i-1], route[i+1])
                if aligned:
                    if steps_still > Step.steps_per_cell:
                        stp = Midsteps(ct, start_h, True, Step.steps_per_cell)
                        route_steps.append(stp)
                        steps_count += Step.steps_per_cell
                    else:
                        stp = Midsteps(ct, start_h, True, steps_still)
                        route_steps.append(stp)
                        steps_count += steps_still
                else:
                    stp = Landing(ct, start_h, True, 1)
                    route_steps.append(stp)
                    steps_count += 1
            else:
                stp = Landing(ct, start_h, True, 1)
                route_steps.append(stp)
                steps_count += 1

if attempts < limit:
    route_pts = []
    for cell in route:
        ct = cell.centroid
        route_pts.append(ct)
    print("Solution generated")
# ---------- end stairsolver_2 ----------

# ----
# "Orient" the steps
pt_4 = Point(python.centroids)
dist = Distance(PointA=graft(pt_4), PointB=pt)
num = Number("0")
mindex_2 = MemberIndex(Set=dist, Member=num)  # -> Index, Count
lng = ListLength(List=pt_4)
item_5 = ListItem(List=flatten(sqgrid.Cells), Index=flatten(mindex_2.Index), Wrap=True)
cull_i = CullIndex(List=pt_4, Indices=expr("x-1", lng), Wrap=True)
shift = ShiftList(List=pt_4, Shift=1, Wrap=False)
debrep = DeconstructBrep(Brep=item_5)  # -> Faces, Edges, Vertices
ln = Line(StartPoint=cull_i, EndPoint=shift)
eval = EvaluateCurve(Curve=reparameterize(debrep.Edges), Parameter="0")  # -> Point, Tangent, Angle
eval_2 = EvaluateCurve(Curve=reparameterize(ln), Parameter="0")  # -> Point, Tangent, Angle
mindex_3 = MemberIndex(Set=eval.Tangent, Member=graft(eval_2.Tangent))  # -> Index, Count
lng_2 = ListLength(List=flatten(mindex_3.Index))
addition = Addition(A=mindex_3.Index, B="1")
addition_2 = Addition(A=mindex_3.Index, B="3")
dup = DuplicateData(Data="1", Number=lng_2, Order=True)
ins = InsertItems(List=addition, Item=addition_2, Indices=graft(dup), Wrap=True)
item_6 = ListItem(List=debrep.Edges, Index=ins, Wrap=True)
midpt = CurveMiddle(Curve=item_6)

# ----
# Create steps and landings
expression = Expression(x=python.substeps, Expression="If(x=0, 1, x)")
item_7 = ListItem(List=midpt, Index=0, Wrap=True)  # -> simplify(Item), Item1
item_8 = ListItem(List=item_6, Index=0, Wrap=True)  # -> simplify(Item1), Item
ln_2 = Line(StartPoint=item_7.Item1, EndPoint=item_7.Item)
divide = DivideCurve(Curve=ln_2, Count=graft(expression), Kinks=False)  # -> Points, Tangents, Parameters
item_9 = ListItem(List=divide.Points, Index=0, Wrap=True)
vec2pt = Vector2Pt(PointA=item_9, PointB=divide.Points, Unitize=False)  # -> Vector, Length
move = Move(Geometry=item_8.Item1, Motion=vec2pt.Vector)  # -> Geometry, Transform
lng_3 = ListLength(List=move.Geometry)  # -> expr("x-1", Length)
shift_2 = ShiftList(List=move.Geometry, Shift=1, Wrap=False)  # -> graft(List)
cull_i_2 = CullIndex(List=move.Geometry, Indices=lng_3, Wrap=True)  # -> graft(List)
sort_2 = SortList(Keys=expression)  # -> reverse(Keys), ValuesA
item_10 = ListItem(List=sort_2.Keys, Index=0, Wrap=True)
loft = Loft(
    Curves=[cull_i_2, shift_2],
    Options={Adjust=False, Closed=False, LoftEnds=0, LoftSimp=0, LoftType=0, Rebuild=10, Refit=0.01})

# ----
# Create geometry
ma = MassAddition(Input=expression)  # -> Result, PartialResults

# ----
# Visualization
ma_2 = MassAddition(Input=expression)  # -> Result, PartialResults
series = Series(Start=0, Step=stairsolver.step_height, Count=ma_2.Result)
Z = UnitZ(Factor=1)
amp = Amplitude(Vector=Z, Amplitude=series)
extr = Extrude(Base=loft, Direction=graft(amp))

# ---- group: Number cells and steps
debrep_2 = DeconstructBrep(Brep=extr)  # -> Faces, Edges, Vertices
item_11 = ListItem(List=debrep_2.Faces, Index=0, Wrap=True)  # -> Item1, Item
sunion_2 = SolidUnion(Breps=flatten(item_11.Item1))
area_4 = Area(Geometry=sunion_2)  # -> Area, Centroid
points = PointList(Points=flatten(area_4.Centroid), Size=Slider(0.1, range=0.1..0.5))
points_2 = PointList(Points=python.centroids, Size=Slider(0.2, range=0.1..0.5))

# ---- group: Preview options
brep = Brep(extr)
join_2 = BrepJoin(Breps=flatten(brep))  # -> Breps, Closed
preview = CustomPreview(Geometry=flatten(join_2.Breps), Material=ColourSwatch(SwatchColor=RGB(147, 191, 178)))

# ---- group: Calculations for each configuration
cull_i_3 = CullIndex(List=join_2.Breps, Indices=0, Wrap=True)
len = Length(Curve=ln)
volume = Volume(Geometry=flatten(cull_i_3))  # -> Volume, Centroid
ma_3 = MassAddition(Input=len)  # -> simplify(Result), PartialResults
lng_4 = ListLength(List=python.centroids)  # -> simplify(Length)
total_length = Panel(ma_3.Result)
cells_used = Panel(lng_4)

# ----
ma_4 = MassAddition(Input=volume.Volume)  # -> Result, PartialResults

# ---- group: Calculations for each configuration (continued)
total_volume = Panel(ma_4.Result)
